# Dynamo graph debug.dyn (Dynamo 2.4.1.6394)

code_block = CodeBlock { "Huber"; "Stefan"; "TUMCMS"; }
IFC_root = IfcInfraToolkit_Dyn.IFC_root.IFC_root(familyName=code_block.out0, firstName=code_block.out1, organization=code_block.out2)
IFC_road_add = IfcInfraToolkit_Dyn.IFC_root.IFC_road_add(iFC_root=IFC_root)  # unwired: stations, width_left, width_right, slope_left, slope_right
code_block_2 = CodeBlock { "sample_ifcroad"; "."; }
IFC_export = IfcInfraToolkit_Dyn.IFC_root.IFC_export(iFC_root=IFC_road_add, modelName=code_block_2.out0, filepath=code_block_2.out1)
