# Dynamo graph CreateElement_semantic.dyn (Dynamo 2.10.0.3455)

code_block = CodeBlock { "null"; "testFacility"; }
createIfcModel = IfcInfraToolKit_DynamoCore.IfcModelSetup.CreateIfcModel(projectName=code_block.out0, siteName=code_block.out0)
addFacility = IfcInfraToolKit_DynamoCore.SpatialStructureDesigner.AddFacility(databaseContainer=createIfcModel, hostGuid=code_block.out0, facilityName=code_block.out1)
code_block_2 = CodeBlock { "IfcBeam"; }
code_block_3 = CodeBlock { "my Wall"; }
addElement = IfcInfraToolKit_DynamoCore.ElementDesigner.AddElement(databaseContainer=addFacility.DatabaseContainer, IfcClass=code_block_2, elementName=code_block_3, hostGuid=addFacility.FacilityGUID)
getElementItems = IfcInfraToolKit_DynamoCore.IfcModelSetup.GetElementItems(databaseContainer=addElement.DatabaseContainer)
watch = Watch(getElementItems.Names)
watch_2 = Watch(getElementItems.IfcClasses)
