# Dynamo graph CreateSpatialStructure.dyn (Dynamo 2.10.0.3455)

# group: User Input
code_block = CodeBlock { "null"; "SampleFacility"; }
directory_path = Directory("C:\Users\Sebastian Esser\Desktop")
code_block_2 = CodeBlock { "spatial_updated"; }
code_block_3 = CodeBlock { "SamplePart"; }

# group: IFC interaction
createIfcModel = IfcInfraToolKit_DynamoCore.IfcModelSetup.CreateIfcModel()

addFacility = IfcInfraToolKit_DynamoCore.SpatialStructureDesigner.AddFacility(databaseContainer=createIfcModel, hostGuid=code_block.out0, facilityName=code_block.out1)
watch = Watch(addFacility.FacilityGUID)
addFacilityPart = IfcInfraToolKit_DynamoCore.SpatialStructureDesigner.AddFacilityPart(databaseContainer=addFacility.DatabaseContainer, hostGuid=watch)

# group (continued): IFC interaction
saveIfcModel = IfcInfraToolKit_DynamoCore.IfcModelSetup.SaveIfcModel(container=addFacilityPart.DatabaseContainer, path=directory_path, modelName=code_block_2)

watch_2 = Watch(addFacilityPart.FacilityPartGUID)
