# Dynamo graph CreateSpatialStructure_FacilityPartPDT.dyn (Dynamo 2.10.0.3455)

# group: PredefinedType of IfcFacilityPart
getAvailableFacilityPartTypes = IfcInfraToolKit_DynamoCore.SpatialStructureDesigner.GetAvailableFacilityPartTypes()
watch = Watch(getAvailableFacilityPartTypes)
code_block = CodeBlock(list=watch) { list[1]; }
getPredefinedType = IfcInfraToolKit_DynamoCore.SpatialStructureDesigner.GetPredefinedType(facilityPartEnum=code_block)
code_block_2 = CodeBlock(list=getPredefinedType) { list[5]; }
getPredefinedFacilityPartUsage = IfcInfraToolKit_DynamoCore.SpatialStructureDesigner.GetPredefinedFacilityPartUsage()
code_block_3 = CodeBlock(list=getPredefinedFacilityPartUsage) { list[2]; }

# group: IFC content
createIfcModel = IfcInfraToolKit_DynamoCore.IfcModelSetup.CreateIfcModel()
addFacility = IfcInfraToolKit_DynamoCore.SpatialStructureDesigner.AddFacility(databaseContainer=createIfcModel)
code_block_4 = CodeBlock { "TestFacilityPart"; }
addFacilityPart = IfcInfraToolKit_DynamoCore.SpatialStructureDesigner.AddFacilityPart(databaseContainer=addFacility.DatabaseContainer, hostGuid=addFacility.FacilityGUID, name=code_block_4, facilityType=code_block, facilityPartType=code_block_2, usageType=code_block_3)

# group: Check Ifc content
getSpatialStructureItems = IfcInfraToolKit_DynamoCore.IfcModelSetup.GetSpatialStructureItems(databaseContainer=addFacilityPart.DatabaseContainer)
watch_2 = Watch(getSpatialStructureItems.IfcClasses)
watch_3 = Watch(getSpatialStructureItems.PredefinedTypes)

watch_4 = Watch(code_block_2)
watch_5 = Watch(code_block)
