# Dynamo graph CreateSpatialStructure_Road.dyn (Dynamo 2.10.0.3455)

createIfcModel = IfcInfraToolKit_DynamoCore.IfcModelSetup.CreateIfcModel()
code_block = CodeBlock { "null"; "SampleFacility"; }
addFacility = IfcInfraToolKit_DynamoCore.SpatialStructureDesigner.AddFacility(databaseContainer=createIfcModel, hostGuid=code_block.out0, facilityName=code_block.out1)
addFacilityPart = IfcInfraToolKit_DynamoCore.SpatialStructureDesigner.AddFacilityPart(databaseContainer=addFacility.DatabaseContainer, hostGuid=addFacility.FacilityGUID)
directory_path = Directory("C:\Users\Sebastian Esser\Desktop")
code_block_2 = CodeBlock { "blub"; }
saveIfcModel = IfcInfraToolKit_DynamoCore.IfcModelSetup.SaveIfcModel(container=addFacilityPart.DatabaseContainer, path=directory_path, modelName=code_block_2)
