# Dynamo graph ObserveIfcContent.dyn (Dynamo 2.10.0.3455)

# group: Open IFC model
file_path = Filename("C:\Users\Sebastian Esser\Desktop\f-bru_enriched_testing_export_select.ifc")
openIfcModel = IfcInfraToolKit_DynamoCore.IfcModelSetup.OpenIfcModel(path=file_path)

# group: All IfcObjectDefinition items
getRootedItems = IfcInfraToolKit_DynamoCore.IfcModelSetup.GetRootedItems(databaseContainer=openIfcModel)
watch = Watch(getRootedItems.GUIDs)
watch_2 = Watch(getRootedItems.Names)
watch_3 = Watch(getRootedItems.IfcClasses)

# group: SpatialStructure items
getSpatialStructureItems = IfcInfraToolKit_DynamoCore.IfcModelSetup.GetSpatialStructureItems(databaseContainer=openIfcModel)
watch_4 = Watch(getSpatialStructureItems.GUIDs)
watch_5 = Watch(getSpatialStructureItems.Names)
watch_6 = Watch(getSpatialStructureItems.IfcClasses)
watch_7 = Watch(getSpatialStructureItems.PredefinedTypes)
