# Dynamo graph OpenExistingModel.dyn (Dynamo 2.8.0.2471)

file_path = Filename("C:\dev\IFCSampleFiles\LevelCrossing\LevelCrossing_MockUp_IFC2x3\TUMCMS_LevelCrossing_MockUp 2x3.ifc")
openIfcModel = IfcInfraToolKit_DynamoCore.IfcModelSetup.OpenIfcModel(path=file_path)
watchIFC = IfcInfraToolKit_DynamoCore.IfcModelSetup.WatchIFC(databaseContainer=openIfcModel)
