# Dynamo graph advancedGeometryExport.dyn (Dynamo 2.10.0.3455)
# packages: MeshToolkit 3.0.0

# group: Dynamo Geometry + MeshToolkit
code_block = CodeBlock { 2; }
byWidthLength = Rectangle.ByWidthLength(length=code_block)
code_block_2 = CodeBlock { 10; }
byAxis = Helix.ByAxis(pitch=code_block_2)
bySweep = Solid.BySweep(profile=byWidthLength, path=byAxis)
byGeometry = Autodesk.Dynamo.MeshToolkit.Mesh.ByGeometry(inputGeometry=bySweep)
triangles = Autodesk.Dynamo.MeshToolkit.Mesh.Triangles(mesh=byGeometry)
byJoinedSurfaces = Solid.ByJoinedSurfaces(facesOfSolid=triangles)

code_block_3 = CodeBlock { "IfcColumn"; "Column1"; "null"; }
directory_path = Directory("C:\Users\Sebastian Esser\Desktop")
code_block_4 = CodeBlock { "helixGeometry"; }

# group: IFC model generation
createIfcModel = IfcInfraToolKit_DynamoCore.IfcModelSetup.CreateIfcModel()
addElement = IfcInfraToolKit_DynamoCore.ElementDesigner.AddElement(databaseContainer=createIfcModel, IfcClass=code_block_3.out0, elementName=code_block_3.out1, hostGuid=code_block_3.out2)
addSolidGeometryAsBRep = IfcInfraToolKit_DynamoCore.DynamoGeometryExporter.AddSolidGeometryAsBRep(solidGeometry=byJoinedSurfaces, databaseContainer=addElement.DatabaseContainer, elementGuid=addElement.ElementGUID)
saveIfcModel = IfcInfraToolKit_DynamoCore.IfcModelSetup.SaveIfcModel(container=addSolidGeometryAsBRep.DatabaseContainer, path=directory_path, modelName=code_block_4)
