# Dynamo graph simpleGeometryExport.dyn (Dynamo 2.10.0.3455)

# group: User Input
code_block = CodeBlock { "null"; }
code_block_2 = CodeBlock { 10; 50; 200; }
directory_path = Directory("C:\Users\Sebastian Esser\Desktop")
code_block_3 = CodeBlock { "cuboid"; }

# group: Geometry Modeling
byLengths = Cuboid.ByLengths(width=code_block_2.out0, length=code_block_2.out1, height=code_block_2.out2)

# group: IFC model setup
createIfcModel = IfcInfraToolKit_DynamoCore.IfcModelSetup.CreateIfcModel()

code_block_4 = CodeBlock { "null"; }
exportSolidGeometryAsBRep = IfcInfraToolKit_DynamoCore.DynamoGeometryExporter.ExportSolidGeometryAsBRep(solidGeometry=byLengths, databaseContainer=createIfcModel, productGuid=code_block_4)

# group (continued): IFC model setup
saveIfcModel = IfcInfraToolKit_DynamoCore.IfcModelSetup.SaveIfcModel(container=exportSolidGeometryAsBRep.DatabaseContainer, path=directory_path, modelName=code_block_3)
