# Dynamo graph PTworkflow_GetGeomData.dyn (Dynamo 2.8.0.2471)

file_path = Filename("geometryFiles\LoD200\pathway.off")
loadOffGeometry = IfcInfraToolKit_DynamoCore.MeshImporter.LoadOffGeometry(offFilePath=file_path)
list_create = List.Create(item0=loadOffGeometry)
toDynamoPatches = IfcInfraToolKit_DynamoCore.MeshImporter.ToDynamoPatches(geometry=list_create)
byJoinedSurfaces = Solid.ByJoinedSurfaces(facesOfSolid=toDynamoPatches)
createIfcModel = IfcInfraToolKit_DynamoCore.IfcModelSetup.CreateIfcModel()
code_block = CodeBlock { "null"; }
getGeometryInformation = IfcInfraToolKit_DynamoCore.DynamoGeometryExporter.GetGeometryInformation(solidGeometry=byJoinedSurfaces, databaseContainer=createIfcModel, productGuid=code_block)
watch = Watch(getGeometryInformation.solidVertices)
watch_2 = Watch(getGeometryInformation.solidEdges)
watch_3 = Watch(getGeometryInformation.solidFaces)
watch_4 = Watch(getGeometryInformation.centerOfGravity)
directory_path = Directory("C:\Users\Sebastian Esser\Desktop")
code_block_2 = CodeBlock { "geom"; }
saveIfcModel = IfcInfraToolKit_DynamoCore.IfcModelSetup.SaveIfcModel(container=getGeometryInformation.DatabaseContainer, path=directory_path, modelName=code_block_2)
